# Requirement set requisitos (R2021b)

## 1 [Velocidad de subida]
El misil tiene que ser capaz de subir a cierto nivel de vuelo en menos de x tiempo.
Verificar en Test
Keywords: velocidad subida misil nivel de vuelo

## 2 [Alcance] Alcance mínimo
El misil tiene que ser capaz de superar cierto distancia horizontal para cierto tiempo de empuje máximo.
Keywords: alcance, missile range